# Grasshopper definition angkor.gh (Grasshopper 0.9.14)

wave = Slider(0.5, range=0.5..3)
stroke = Slider(0.2, range=0.2..2)
seed1 = Slider(9, range=2..50)
density = Slider(1, range=1..20)
simmetry = Slider(3, range=1..6)
seed2 = Slider(50, range=2..50)
xy = XYPlane(Origin=Point(0, 0, 0))
num = Number(density)
num_2 = Number(seed2)
num_3 = Number(seed1)
cir = Circle(Plane=xy, Radius=20)
eval = Evaluate(F="(x*2)-0.03", x=stroke)
divlength = DivideLength(Curve=cir, Length=eval)  # -> Points, Tangents, Parameters
eval_2 = Evaluate(F="360/x", x=simmetry)
len = Length(Curve=cir)
dist = Distance(PointA=xy, PointB=divlength.Points)
series = Series(Start=0, Step=eval_2, Count=simmetry)
eval_3 = Evaluate(F="x-10", x=len)
dom = Domain(DomainStart=0, DomainEnd=len)
eval_4 = Evaluate(F="0.25 + ((1 + sin(x*y)) / 2)", x=dist, y=wave)
mesh_cylinder_vb = VBScript(x=stroke)  # -> out, A
# ---------- mesh_cylinder_vb: VB ----------
    Dim radius As Double
    Dim faces As Integer
    radius = x
    'Math.Floor(((Math.Floor(radius * 10) - 1) / 2.0)) + 1)*6
    'faces = Math.Floor(((Math.Floor(radius * 10) - 1) / 2.0)) + 1)*6
    faces = (Math.floor((Math.Floor(radius * 10) - 1) / 2.0)+1)*6
    Dim circle As Circle
    Dim cylinder As Cylinder
    Dim mesh As Mesh
    'New Rhino.Geometry.Circle(
    circle = New Rhino.Geometry.Circle(radius)
    cylinder = New Rhino.Geometry.Cylinder(circle, 1)
    mesh = Rhino.Geometry.Mesh.CreateFromCylinder(cylinder, 1, faces)
    A = RhinoDoc.ActiveDoc.Objects.AddMesh(mesh)
# ---------- end mesh_cylinder_vb ----------
dom_2 = Domain(DomainStart=10, DomainEnd=eval_3)
random = Random(Range=dom, Number=num, Seed=num_3)
scale_nu = ScaleNU(Geometry=mesh_cylinder_vb.A, Plane=PlaneXY(0, 0, 0), ScaleX=1, ScaleY=1, ScaleZ=eval_4)  # -> Geometry, Transform
random_2 = Random(Range=dom_2, Number=num, Seed=num_2)
addition = Addition(A=random, B=random_2)
rad = Radians(Degrees=series)  # -> graft(Radians)
move = Move(Geometry=scale_nu.Geometry, Motion=divlength.Points)  # -> simplify(flatten(Geometry)), Transform
hframe = HorizontalFrame(Curve=cir, Parameter=random)
hframe_2 = HorizontalFrame(Curve=cir, Parameter=addition)
ln = Line(StartPoint=hframe, EndPoint=hframe_2)
crv = Curve(ln)
divlength_2 = DivideLength(Curve=crv, Length=eval)  # -> simplify(flatten(Points)), Tangents, Parameters
dist_2 = Distance(PointA=xy, PointB=divlength_2.Points)
eval_5 = Evaluate(F="0.25 + ((1 + sin(x*y)) / 2)", x=dist_2, y=wave)
scale_nu_2 = ScaleNU(Geometry=mesh_cylinder_vb.A, Plane=PlaneXY(0, 0, 0), ScaleX=1, ScaleY=1, ScaleZ=eval_5)  # -> Geometry, Transform
move_2 = Move(Geometry=scale_nu_2.Geometry, Motion=divlength_2.Points)  # -> simplify(flatten(Geometry)), Transform
rotate = Rotate(Geometry=move_2.Geometry, Angle=rad, Plane=PlaneXY(0, 0, 0))  # -> Geometry, Transform
