# Grasshopper definition another.gh (Grasshopper 0.9.6)
# plug-ins: Python Interpreter, WeaverBird

slider = Slider(6, range=3..8)
c_script = CSharpScript()  # -> out, A
# ---------- c_script: C# ----------
    A = @"C:\inetpub\ftproot\Rendering_Data\GH_Def_files\args_" + System.Diagnostics.Process.GetCurrentProcess().Id + ".txt";
# ---------- end c_script ----------
file = ReadFile(Path=c_script.A, Lines=True)
series = Series(Start=slider, Step=Slider(2.946, range=0.3..3), Count=Slider(1, range=1..10))
addition = Addition(A=Slider(2.2, range=0..6), B=series)
multiplication = Multiplication(A=slider, B=3)
polygon = Polygon(Plane=PlaneXY(0, 0, 0), Radius=series, Segments=slider, FilletRadius=0)  # -> graft(Polygon), Length
item = ListItem(List=file, Index=0, Wrap=False)
polygon_2 = Polygon(Plane=PlaneXY(0, 0, 0), Radius=addition, Segments=slider, FilletRadius=0)  # -> graft(Polygon), Length
multiplication_2 = Multiplication(A=item, B=10)
rdiff = RegionDifference(CurvesA=polygon_2.Polygon, CurvesB=polygon.Polygon)
divide = DivideCurve(Curve=polygon_2.Polygon, Count=multiplication, Kinks=False)  # -> Points, Tangents, Parameters
divide_2 = DivideCurve(Curve=polygon.Polygon, Count=multiplication, Kinks=False)  # -> Points, Tangents, Parameters
ln = Line(StartPoint=divide_2.Points, EndPoint=divide.Points)  # -> flatten(Line)
c_script_2 = CSharpScript(lines=ln)  # -> out, A; inputs lines: list
# ---------- c_script_2: C# ----------
    lines.Add(lines[0]);

    Line l1 = new Line(new Point3d(0, 0, 0), new Point3d(0, 0, 1));
    l1 = (Line) lines[0];
    A = l1;
# ---------- end c_script_2 ----------
item_2 = ListItem(List=ln, Index=0, Wrap=False)
vb = VBScript(x=item_2)  # -> out, A; inputs x: Line
# ---------- vb: C# ----------
    A = x.To
# ---------- end vb ----------
c_script_3 = CSharpScript(x=item_2)  # -> out, A; inputs x: Line
# ---------- c_script_3: C# ----------
    A = x.From;
# ---------- end c_script_3 ----------
c_script_4 = CSharpScript(lines=ln)  # -> out, A; inputs lines: list of Line
# ---------- c_script_4: C# ----------
    List<Polyline> poly = new List<Polyline>();
    lines.Add(lines[0]);
    for(int i = 0; i < lines.Count - 1; i++)
    {
      List<Point3d> points = new List<Point3d>();
      points.Add(lines[i].From);
      points.Add(lines[i + 1].From);
      points.Add(lines[i + 1].To);
      points.Add(lines[i].To);
      points.Add(lines[i].From);

      poly.Add(new Polyline(points));
    }
    A = poly;
# ---------- end c_script_4 ----------
planar = PlanarSrf(Edges=c_script_4.A)
smesh = SimpleMesh(Brep=planar)
mjoin = MeshJoin(Meshes=smesh)
wbcatmullclark = WeaverBirdsCatmullClarkSubdivision(MeshCurves=mjoin, Level=1, SmoothNakedEdges=1)
wbcarpet = WeaverBirdsSierpinskiCarpet(MeshPolylines=wbcatmullclark, Distance=20, InsetType=0)
wbthicken = WeaverBirdsMeshThicken(Mesh=wbcarpet, Distance=1, OffsetType=0)
stam = WeaverBirdsCatmullClarkSubdivision(MeshCurves=wbthicken, Level=3, SmoothNakedEdges=1)
curvepoint = PointOnCurve(ln, parameter=1)
curvepoint_2 = PointOnCurve(ln, parameter=0)
python = PythonScript()  # -> out, a; inputs x: list; disabled
# ---------- python: Python ----------
import rhinoscriptsyntax as rs
a=[]
x.append(x[0])
for i in range(len(x)-1):
    #l1 = rs.AddLine(rs.CurveStartPoint(x[i]),rs.CurveStartPoint(x[i+1]))
    l = rs.AddPolyline([rs.CurveStartPoint(x[i]),rs.CurveStartPoint(x[i+1]),rs.CurveEndPoint(x[i+1]),rs.CurveEndPoint(x[i]),rs.CurveStartPoint(x[i])])
    a.append(l)
# ---------- end python ----------
Z = UnitZ(Factor=2)
c_script_5 = CSharpScript(lines=curvepoint_2)  # -> out, A; inputs lines: list of Point3d
# ---------- c_script_5: C# ----------
    Line b = new Line(lines[0], lines[1]);
    A = b;
# ---------- end c_script_5 ----------
move = Move(Geometry=stam, Motion=Z)  # -> Geometry, Transform
all = Geometry(move.Geometry)
