# Grasshopper definition vase3.gh (Grasshopper 0.8.66)

rad1 = Number(0.7)
rad3 = Number(0.3)
rad2 = Number(0.3)
rad4 = Number(0.3)
all = CSharpScript(r1=rad1, r2=rad2, r3=rad3, r4=rad4)  # -> out, A; inputs r1: Double, r2: Double, r3: Double, r4: Double
# ---------- all: C# ----------
    r1 = r1 * 6 + 1;
    r2 = r2 * 6 + 1;
    r3 = r3 * 6 + 1;
    r4 = r4 * 6 + 1;

    Curve crv = CreateVaseCurve(r1, r2, r3, r4);
    RevSurface srf = CreateVase(crv);
    A = srf;
# ---------- all: C# additional code ----------
  private Curve CreateVaseCurve(double r1, double r2, double r3, double r4)
  {
    List<Point3d> points = new List<Point3d>(4);
    points.Add(new Point3d(r1, 0, 0));
    points.Add(new Point3d(r2, 0, 3));
    points.Add(new Point3d(r3, 0, 6));
    points.Add(new Point3d(r4, 0, 10));

    Curve crv = Curve.CreateInterpolatedCurve(points, 3);
    return crv;
  }
  private RevSurface CreateVase(Curve crv)
  {
    Line axis = new Line(new Point3d(0, 0, 0), new Point3d(0, 0, 10));
    RevSurface srf = Rhino.Geometry.RevSurface.Create(crv, axis);

    return srf;
  }
  /*private List<Circle> GetVaseCircles(Curve crv, int NumCircles)
  {

  }*/
# ---------- end all ----------
