# Grasshopper definition voronoi_tiles_new.gh (Grasshopper 0.9.14)

a0 = Number(0.4)
a1 = Number(4)
a3 = Number(21)
a2 = Number(27.5)
int = Integer(a3)
int_2 = Integer(a2)
int_3 = Integer(a1)
expression = Expression(x=a0, y=int_3, Expression="floor((35/y)*x)+1")
stroke = Slider(27, range=10..40)
slider = Slider(1, range=0..1)
pattern = Slider(25, range=2..50)
density = Slider(30, range=1..30)
tiles = Slider(4, range=2..12)
necklace_connector_thikness = Number(1.7)
necklace = Necklace(connector_thikness=necklace_connector_thikness)
pendant = Pendant(D=int_2, number_of_points=expression, seed=int, int=int_3)
placement = Placement(G=pendant, A=necklace_connector_thikness, C=necklace)
all = Geometry([necklace, placement])

# ==== cluster Necklace
cat = Catenary(PointA=Point(7, 56, 0), PointB=Point(23, 56, 0), Length=43.7, Gravity=Vector(0, -1, 0))
divdist = DivideDistance(Curve=cat, Distance=0.7)  # -> Points, Tangents, Parameters
torus = TorusSurface(
    UDivisions=10,
    VDivisions=10,
    CParameter=2,
    RParameter=0.8,
    TParameter=1,
    Scale=0.28,
    Domain1=Domain(0, 6.283185307),
    Domain2=Domain(-3.141592654, 3.141592654))
rad = Radians(Degrees=90)
connector_thikness = ClusterInput()
pframe = PerpFrame(Curve=cat, Parameter=divdist.Parameters)
move = Move(Geometry=torus, Motion=divdist.Points)  # -> Geometry, Transform
sift = SiftPattern(List=move.Geometry, SiftPattern=[0, 1, 0, 1])  # -> Output0, Output1
torus_2 = TorusSurface(
    UDivisions=10,
    VDivisions=10,
    CParameter=4,
    RParameter=connector_thikness,
    TParameter=2,
    Scale=0.3,
    Domain1=Domain(0, 6.283185307),
    Domain2=Domain(-3.141592654, 3.141592654))
rotate = Rotate(Geometry=sift.Output0, Angle=rad, Plane=pframe)  # -> Geometry, Transform
xz = XZPlane(Origin=Point(0, 0, 0))
rad_2 = Radians(Degrees=90)
geo = Geometry([rotate.Geometry, sift.Output1])
move_2 = Move(Geometry=geo, Motion=Vector(0, 0, 1.4))  # -> Geometry, Transform
rotate_2 = Rotate(Geometry=torus_2, Angle=rad_2, Plane=xz)  # -> Geometry, Transform
move_3 = Move(Geometry=rotate_2.Geometry, Motion=Vector(15, 36.5, 1.6))  # -> Geometry, Transform
geo_2 = Geometry(simplify(flatten([move_3.Geometry, move_2.Geometry])))
geo_3 = ClusterOutput(geo_2)

# ==== cluster Pendant
number_of_points = ClusterInput()
seed = ClusterInput()
int = ClusterInput()
D = ClusterInput()
size = Slider(27, range=20..50)
int_2 = Integer(int)
expression = Expression(x=number_of_points, y=int_2, Expression="if(x*y > 30, 2,3)")
multiplication = Multiplication(A=number_of_points, B=int_2)
rectangle = Rectangle(Plane=PlaneXY(0, 0, 0), XSize=size, YSize=size, Radius=0)  # -> Rectangle, Length
height = Slider(2, range=2..4)
subtraction = Subtraction(A=int_2, B=1)
eval = Evaluate(F="x/y", x=size, y=int_2)
random_points = RandomPoints(points=number_of_points, max=eval, seed=seed)
random_points_2 = RandomPoints(points=number_of_points, max=eval, seed=seed)
sqgrid = Square(Plane=PlaneXY(0, 0, 0), Size=eval, ExtentX=subtraction, ExtentY=subtraction)  # -> Cells, flatten(Points)
offset = Offset(Curve=rectangle.Rectangle, Distance=1.3, Plane=PlaneXY(0, 0, 0), Corners=1)
move = Move(Geometry=random_points_2, Motion=graft(sqgrid.Points))  # -> Geometry, Transform
curve_bounded_voronoi = CurveBoundedVoronoi(P=move.Geometry, B=rectangle.Rectangle)
corners = Corners(C_2=offset, C=rectangle.Rectangle)
wbcarpet = WeaverBirdsSierpinskiCarpet(MeshPolylines=curve_bounded_voronoi, Distance=D, InsetType=0)
mcomp = Decompose(Mesh=wbcarpet)  # -> Vertices, Faces, Colours, Normals
crv_cp = CurveCP(Point=mcomp.Vertices, Curve=rectangle.Rectangle)  # -> Point, Parameter, Distance
smaller = SmallerThan(FirstNumber=crv_cp.Distance, SecondNumber=0.001)  # -> SmallerThan, OrEqualTo
cull = CullPattern(List=crv_cp.Point, CullPattern=smaller.SmallerThan)
cluster = Cluster_2(C_2=offset, C=rectangle.Rectangle, input=cull)
cluster_2 = Cluster(M=[cluster, corners, wbcarpet], height=height, L=expression)
O = ClusterOutput(cluster_2)

# ==== cluster Placement
C = ClusterInput()
G = ClusterInput()
bbox_points = BboxPoints(C=C)  # -> E, E_2
A = ClusterInput()
rad = Radians(Degrees=45)
rotate = Rotate(Geometry=G, Angle=rad, Plane=PlaneXY(0, 0, 0))  # -> Geometry, Transform
bbox_points_2 = BboxPoints(C=rotate.Geometry)  # -> E, E_2
subtraction = Subtraction(A=bbox_points.E, B=bbox_points_2.E_2)
division = Division(A=A, B=2)
vec = VectorXYZ(XComponent=0, YComponent=division, ZComponent=0)  # -> Vector, Length
move = Move(Geometry=rotate.Geometry, Motion=subtraction)  # -> Geometry, Transform
move_2 = Move(Geometry=move.Geometry, Motion=vec.Vector)  # -> Geometry, Transform
G_2 = ClusterOutput(move_2.Geometry)

# ==== cluster RandomPoints: Generate random points in a square
points = ClusterInput()
max = ClusterInput()
seed = ClusterInput()
dom = Domain(DomainStart=0, DomainEnd=max)
eval = Evaluate(F="x/20", x=seed)
distinct_list = DistinctList()
random = Random(Range=dom, Number=points, Seed=seed)
random_2 = Random(Range=dom, Number=points, Seed=eval)
pt = PointXYZ(XComponent=random, YComponent=random_2, ZComponent=0, System=PlaneXY(0, 0, 0))
shift = ShiftList(List=pt, Shift=1, Wrap=False)
vb = VBScript()  # -> out, A; inputs x: list, y: list
# ---------- vb: VB ----------
    Dim res As New List(Of Integer)
    Dim dx As Double
    Dim dy As Double
    For i As Integer = 0 To x.Count - 1
      For j As Integer = i + 1 To x.Count
        For k As Integer = 0 To res.Count
          dx = x(res(k)) - x(j)
          dy = y(res(k)) - y(j)
          If(math.Sqrt(math.Pow(dx, 2) + math.Pow(dy, 2)) < 0.1) Then
            
          End If
        Next
        
      Next
    Next
# ---------- end vb ----------
dist = Distance(PointA=simplify(graft(pt)), PointB=simplify(pt))  # -> simplify(Distance)
pt_2 = ClusterOutput(pt)
panel = Panel(dist)

# ==== cluster CurveBoundedVoronoi
P = ClusterInput()
B = ClusterInput()
voronoi = Voronoi(Points=flatten(P), Radius=50, Plane=PlaneXY(0, 0, 0), BruteForceOverride=False)
rint = RegionIntersection(CurvesA=voronoi, CurvesB=B)
int = Integer(7)
disc = Discontinuity(Curve=rint, Level=1)  # -> Points, Parameters
round_point = RoundPoint(P=disc.Points, y=int)
pline = PolyLine(Vertices=round_point, Closed=False)  # -> flatten(Polyline)
pl = ClusterOutput(pline)

# ==== cluster Cluster
height = ClusterInput()
M = ClusterInput()
L = ClusterInput()
mjoin = MeshJoin(Meshes=simplify(flatten(M)))
mcomp = Decompose(Mesh=simplify(flatten(mjoin)))  # -> flatten(Vertices), flatten(Faces), Colours, Normals
vb = VBScript(x=mjoin)  # -> out, A; inputs x: Mesh; disabled
# ---------- vb: VB ----------
    x.Vertices.CombineIdentical(True, True)
    Dim v() As Point3d
    v = x.Vertices.ToPoint3dArray()
    'Dim remove_vertices() As Integer
    Dim remove_vertices As New List(Of Integer)
    Dim count As Integer = 0
    For i As Integer = 0 To x.Vertices.Count() - 2
      'A = v(i)
      For j As Integer = i + 1 To x.Vertices.Count() - 1
        If (v(i).DistanceTo(v(j)) < 0.0001) Then
          If Not remove_vertices.Contains(j) Then remove_vertices.Add(j)
          'remove_vertices.Add(j)
          count = count + 1
          Dim ff() As Int32
          Dim f As Rhino.Geometry.MeshFace
          Dim nf As Rhino.Geometry.MeshFace
          ff = x.Vertices.GetVertexFaces(j)
          For k As Integer = 0 To ff.GetUpperBound(0)
            f = x.Faces.GetFace(ff(k))
            If (f.A = j) Then
              nf.Set(i, f.B, f.C, f.D)
            End If
            If (f.B = j) Then
              nf.Set(f.A, i, f.C, f.D)
            End If
            If (f.C = j) Then
              nf.Set(f.A, f.B, i, f.D)
            End If
            If (f.D = j) Then
              nf.Set(f.A, f.B, f.C, i)
            End If
            x.Faces.AddFace(nf)
          Next
          'x.Vertices.Remove(j, False)
        End If
      Next
    Next

    remove_vertices.Sort()
    'remove_vertices.TrimExcess()
    'print
    'For Each vv As Integer In  remove_vertices
    For i As Integer = remove_vertices.Count() - 1 To 0 Step -1

      'Console.WriteLine("aaa")
      'Print(remove_vertices(i).ToString())
      'For i As Integer = remove_vertices.Count() - 1 To 0
      x.Vertices.Remove(remove_vertices(i), False)
    Next
    A = x
# ---------- end vb ----------
int = Integer(7)
round_point = RoundPoint(P=mcomp.Vertices, y=int)
mesh = Mesh(Vertices=round_point, Faces=mcomp.Faces)
wbthicken = WeaverBirdsMeshThicken(Mesh=mesh, Distance=height, OffsetType=0)
wbcatmullclark = WeaverBirdsCatmullClarkSubdivision(MeshCurves=wbthicken, Level=L, SmoothNakedEdges=0)
wblaplace = WeaverBirdsLaplacianSmoothing(MeshCurves=wbcatmullclark, Level=2, SmoothNakedEdges=1, Thin=1)
O = ClusterOutput(wblaplace)

# ==== cluster Corners
C = ClusterInput()
C_2 = ClusterInput()
disc = Discontinuity(Curve=C_2, Level=1)  # -> Points, Parameters
disc_2 = Discontinuity(Curve=C, Level=1)  # -> Points, Parameters
xy = XYPlane(Origin=Point(0, 0, 0))
dist = Distance(PointA=simplify(disc.Points), PointB=simplify(graft(disc_2.Points)))
pcomp = PlaneComponents(Plane=xy)  # -> Origin, XAxis, YAxis, ZAxis
expression = Expression(x=flatten(dist), Expression="if(x<5,True,False)")
neg = Negative(Value=pcomp.ZAxis)
pl = PlaneNormal(Origin=pcomp.Origin, ZAxis=neg)
rec_2pt = Rectangle2Pt(Plane=pl, PointA=simplify(disc.Points), PointB=simplify(graft(disc_2.Points)), Radius=0)  # -> flatten(Rectangle), Length
pcomp_2 = PlaneComponents(Plane=pl)  # -> Origin, XAxis, YAxis, ZAxis
cull = CullPattern(List=rec_2pt.Rectangle, CullPattern=expression)
planar = PlanarSrf(Edges=cull)
flip = Flip(Surface=planar)  # -> Surface, Result
smesh = SimpleMesh(Brep=flip.Surface)
M = ClusterOutput(smesh)

# ==== cluster Cluster_2
C = ClusterInput()
C_2 = ClusterInput()
input = ClusterInput()
disc = Discontinuity(Curve=C_2, Level=1)  # -> Points, Parameters
disc_2 = Discontinuity(Curve=C, Level=1)  # -> Points, Parameters
shatter = Shatter(Curve=C_2, Parameters=disc.Parameters)
shatter_2 = Shatter(Curve=C, Parameters=disc_2.Parameters)
split_border = SplitBorder(P=input, L_2=shatter, L=shatter_2, i=0)
split_border_2 = SplitBorder(P=input, L_2=shatter, L=shatter_2, i=2)
split_border_3 = SplitBorder(P=input, L_2=shatter, L=shatter_2, i=1)
split_border_4 = SplitBorder(P=input, L_2=shatter, L=shatter_2, i=3)
smesh = SimpleMesh(Brep=[split_border_3, split_border, split_border_2, split_border_4])
M = ClusterOutput(smesh)

# ==== cluster BboxPoints
C = ClusterInput()
bbox = BoundingBox(Content=C, Plane=PlaneXY(0, 0, 0), UnionBox=True)  # -> Box, Box_2
explode = BrepComponents(Brep=bbox.Box)  # -> Faces, Edges, Vertices
pcen = PolygonCenter(Polyline=explode.Faces)  # -> CenterV, CenterE
item = ListItem(List=pcen.CenterV, Index=Slider(0, range=0..12), Wrap=False)
item_2 = ListItem(List=pcen.CenterV, Index=Slider(2, range=0..12), Wrap=False)
E = ClusterOutput(item)
E_2 = ClusterOutput(item_2)

# ==== cluster DistinctList
K = ClusterInput()
sort = SortList(Keys=K)  # -> Keys, ValuesA
shift = ShiftList(List=sort.Keys, Shift=1, Wrap=False)
bool = Boolean(True)
equals = Equality(FirstNumber=shift, SecondNumber=sort.Keys)  # -> Equality, Inequality
bool_2 = Boolean(flatten([bool, equals.Inequality]))
cull = CullPattern(List=sort.Keys, CullPattern=bool_2)
L = ClusterOutput(cull)

# ==== cluster RoundPoint
y = ClusterInput()
P = ClusterInput()
pcomp = Decompose(Point=P, System=PlaneXY(0, 0, 0))  # -> XComponent, YComponent, ZComponent
expression = Expression(x=pcomp.ZComponent, y=y, Expression="Round(x,y)")
expression_2 = Expression(x=pcomp.XComponent, y=y, Expression="Round(x,y)")
expression_3 = Expression(x=pcomp.YComponent, y=y, Expression="Round(x,y)")
pt = PointXYZ(XComponent=expression_2, YComponent=expression_3, ZComponent=expression, System=PlaneXY(0, 0, 0))
pt_2 = ClusterOutput(pt)

# ==== cluster SplitBorder
i = ClusterInput()
L = ClusterInput()
L_2 = ClusterInput()
P = ClusterInput()
item = ListItem(List=L_2, Index=i, Wrap=False)
item_2 = ListItem(List=L, Index=i, Wrap=False)
crv_cp = CurveCP(Point=P, Curve=item_2)  # -> flatten(Point), Parameter, Distance
smaller = SmallerThan(FirstNumber=crv_cp.Distance, SecondNumber=1e-05)  # -> SmallerThan, OrEqualTo
cull = CullPattern(List=crv_cp.Point, CullPattern=smaller.SmallerThan)
crv_cp_2 = CurveCP(Point=cull, Curve=item)  # -> flatten(Point), Parameter, Distance
ln = Line(StartPoint=crv_cp_2.Point, EndPoint=cull)  # -> flatten(Line)
sort = SortList(Keys=crv_cp_2.Parameter, ValuesA=ln)  # -> Keys, ValuesA
shift = ShiftList(List=sort.ValuesA, Shift=1, Wrap=False)
end = EndPoints(Curve=shift)  # -> Start, End
end_2 = EndPoints(Curve=sort.ValuesA)  # -> Start, End
weave = Weave(Pattern=[0, 1, 2, 3], Stream0=end_2.End, Stream1=end_2.Start, Stream2=end.Start, Stream3=end.End, NullGaps=False)  # -> simplify(graft(Weave))
path_mapper = PathMapper(weave, source="{A}(i)", target="{A\4}(A%4)")
pline = PolyLine(Vertices=path_mapper, Closed=True)
planar = PlanarSrf(Edges=flatten(pline))
S = ClusterOutput(planar)
