# Grasshopper definition voronoi_tiles_pendant.gh (Grasshopper 0.9.14)
# plug-ins: WeaverBird, LunchBox

cat = Catenary(PointA=Point(7, 56, 0), PointB=Point(23, 56, 0), Length=43.7, Gravity=Vector(0, -1, 0))
divdist = DivideDistance(Curve=cat, Distance=0.7)  # -> Points, Tangents, Parameters
torus = TorusSurface(
    UDivisions=10,
    VDivisions=10,
    CParameter=2,
    RParameter=0.8,
    TParameter=1,
    Scale=0.28,
    Domain1=Domain(0, 6.283185307),
    Domain2=Domain(-3.141592654, 3.141592654))
rad = Radians(Degrees=90)
pframe = PerpFrame(Curve=cat, Parameter=divdist.Parameters)
move = Move(Geometry=torus, Motion=divdist.Points)  # -> Geometry, Transform
a1 = Number(0.4)
a0 = Number(0.4)
a2 = Number(0.4)
a4 = Number(0.4)
a3 = Number(0.4)
center_x = Slider(15, range=0..20)
front_location_y = Slider(12, range=0..100)
front_location_z = Slider(0, range=-50..3)
textparam = String(["L", "O", "V", "E"])
sift = SiftPattern(List=move.Geometry, SiftPattern=[0, 1, 0, 1])  # -> Output0, Output1
font = Panel("Moonracer")  # disabled

# ---- group: Size
size_front = Slider(7.5, range=0..11)

# ----
fudge_logo_location = ValueList({"One": 0, "Two": 1, "Three": 2}, selected=[], ListIndex=0, UIMode=1)
eval = Evaluate(F="x*5", x=a4)
torus_2 = TorusSurface(
    UDivisions=10,
    VDivisions=10,
    CParameter=4,
    RParameter=1.7,
    TParameter=2,
    Scale=0.3,
    Domain1=Domain(0, 6.283185307),
    Domain2=Domain(-3.141592654, 3.141592654))
toggle_bold = BooleanToggle(True)
eval_2 = Evaluate(F="floor(x*6)+3", x=a1)
eval_3 = Evaluate(F="(x*6)+1", x=a0, y=eval_2)
eval_4 = Evaluate(F="(x*37)+3", x=a2)
eval_5 = Evaluate(F="floor((x*12)+2)", x=a3)
inside_x = Slider(-1.4, range=-3..0)
inside_y = Slider(73, range=20..80)
inside_z = Slider(-3, range=-12..0)
rotate = Rotate(Geometry=sift.Output0, Angle=rad, Plane=pframe)  # -> Geometry, Transform
density = Integer(eval_3)
stroke = Number(eval_4)
xz = XZPlane(Origin=Point(0, 0, 0))
pattern = Number(eval_5)
rad_2 = Radians(Degrees=90)
order = Number(eval_2)
join = StringJoin(Strings=textparam)
voronoi_radius_not_interesting = Slider(100, range=2..100)
geo = Geometry([rotate.Geometry, sift.Output1])
randomness = Number(eval)
move_2 = Move(Geometry=geo, Motion=Vector(0, 0, 1.4))  # -> Geometry, Transform

number_of_tiles = Slider(5, range=1..20)
density_2 = Slider(9, range=1..20)
stroke_2 = Slider(20, range=3..40)
density_3 = Integer(density)
order_2 = Number(order)

font_2 = String("Comic Sans MS")
slider = Slider(9, range=2..20)
rotate_2 = Rotate(Geometry=torus_2, Angle=rad_2, Plane=xz)  # -> Geometry, Transform
size = Slider(30, range=20..50)

slider_2 = Slider(26, range=5..50)
dom = Domain(DomainStart=Slider(12, range=0..30), DomainEnd=Slider(20, range=0..30))
dom_2 = Domain(DomainStart=3, DomainEnd=30)
random = Random(Range=dom_2, Number=slider_2, Seed=7)
random_2 = Random(Range=dom, Number=slider_2, Seed=2)
pt = PointXYZ(XComponent=random, YComponent=random_2, ZComponent=0, System=PlaneXY(0, 0, 0))  # disabled

move_3 = Move(Geometry=rotate_2.Geometry, Motion=Vector(15, 36.5, 1.6))  # -> Geometry, Transform
pattern_2 = Number(pattern)
randomness_2 = Number(randomness)
size_2 = Number(size)
stroke_3 = Number(stroke)
cluster = Cluster(face=font_2, bold=toggle_bold, content=join, size=size_front, center_x=center_x, center_y=front_location_y)
eval_6 = Evaluate(F="x/y", x=size_2, y=order_2)
eval_7 = Evaluate(F="max(1,floor(x/(y²)))", x=density_3, y=order_2)
num = Number(eval_6)
brep = Brep(cluster)
multiplication = Multiplication(A=num, B=order_2)
eval_8 = Evaluate(F="x/2", x=pattern_2)
dom_3 = Domain(DomainStart=0, DomainEnd=num)
mesh = MeshBrep(
    Brep=brep,
    Settings={Refine=True, JaggedSeams=False, SimplePlanes=True, GridMinCount=16, GridMaxCount=0, Tolerance=0, RefineAngle=0, MinTolerance=0, RelativeTolerance=0.65, MinEdgeLength=0.0001, MaxEdgeLength=0})
dom_4 = Domain(DomainStart=0, DomainEnd=multiplication)
wbsplitpolygons = WeaverBirdsSplitPolygonsSubdivision(MeshCurves=mesh, Level=2, SmoothNakedEdges=1)
rectangle = Rectangle(Plane=PlaneXY(0, 0, 0), XSize=dom_4, YSize=dom_4, Radius=0)  # -> Rectangle, Length
Z = UnitZ(Factor=1)
random_3 = Random(Range=dom_3, Number=density_3, Seed=pattern_2)
random_4 = Random(Range=dom_3, Number=density_3, Seed=eval_8)
wbthicken = WeaverBirdsMeshThicken(Mesh=wbsplitpolygons, Distance=-4, OffsetType=0)
extr = Extrude(Base=rectangle.Rectangle, Direction=Z)
pt_2 = PointXYZ(XComponent=random_3, YComponent=random_4, ZComponent=0, System=PlaneXY(0, 0, 0))
bbox = BoundingBox(Content=extr, Plane=PlaneXY(0, 0, 0), UnionBox=True)  # -> Box, Box_2
wbcatmullclark = WeaverBirdsCatmullClarkSubdivision(MeshCurves=wbthicken, Level=2, SmoothNakedEdges=1)
series = Series(Start=0, Step=num, Count=order_2)  # -> graft(Series)
series_2 = Series(Start=0, Step=num, Count=order_2)  # -> graft(Series)
wblaplace = WeaverBirdsLaplacianSmoothing(MeshCurves=wbcatmullclark, Level=1, SmoothNakedEdges=1, Thin=1)
X = UnitX(Factor=series_2)
Y = UnitY(Factor=series)
xy = XYPlane(Origin=Point(15, 15, 0))
rad_3 = Radians(Degrees=45)
move_4 = Move(Geometry=pt_2, Motion=X)  # -> simplify(flatten(Geometry)), Transform
rad_4 = Radians(Degrees=-45)
move_5 = Move(Geometry=move_4.Geometry, Motion=Y)  # -> simplify(flatten(Geometry)), Transform
neg = Negative(Value=randomness_2)
dom_5 = Domain(DomainStart=neg, DomainEnd=randomness_2)
rotate_3 = Rotate(Geometry=pt, Angle=rad_4, Plane=xy)  # -> Geometry, Transform
lng = ListLength(List=move_5.Geometry)
voronoi = Voronoi(
    Points=flatten([move_5.Geometry, rotate_3.Geometry]),
    Radius=voronoi_radius_not_interesting,
    Box=bbox.Box,
    Plane=PlaneXY(0, 0, 0),
    BruteForceOverride=False)
tiled_voronoi = Geometry(voronoi)
wbcarpet = WeaverBirdsSierpinskiCarpet(MeshPolylines=tiled_voronoi, Distance=stroke_3, InsetType=0)
rotate_4 = Rotate(Geometry=wbcarpet, Angle=rad_3, Plane=xy)  # -> Geometry, Transform
wbthicken_2 = WeaverBirdsMeshThicken(Mesh=rotate_4.Geometry, Distance=2.5, OffsetType=0)
wbcatmullclark_2 = WeaverBirdsCatmullClarkSubdivision(MeshCurves=wbthicken_2, Level=2, SmoothNakedEdges=0)
wblaplace_2 = WeaverBirdsLaplacianSmoothing(MeshCurves=wbcatmullclark_2, Level=1, SmoothNakedEdges=0, Thin=1)
random_5 = Random(Range=dom_5, Number=lng, Seed=2)
random_6 = Random(Range=dom_5, Number=lng, Seed=7)
geo_2 = Geometry(wblaplace_2)
all = Geometry(flatten([geo_2, wblaplace, move_2.Geometry, move_3.Geometry]))
pt_3 = PointXYZ(XComponent=random_5, YComponent=random_6, ZComponent=0, System=PlaneXY(0, 0, 0))  # -> graft(Point)
move_6 = Move(Geometry=graft(move_5.Geometry), Motion=pt_3)  # -> Geometry, Transform
voronoi_2 = Voronoi(
    Points=flatten(move_6.Geometry),
    Radius=voronoi_radius_not_interesting,
    Box=bbox.Box,
    Plane=PlaneXY(0, 0, 0),
    BruteForceOverride=False)

# ==== cluster Cluster
center_y = ClusterInput()
size = ClusterInput()
center_x = ClusterInput()
face = ClusterInput()
bold = ClusterInput()
content = ClusterInput()
bool = Boolean(False)
extrusion_vec = Vector(Vector(0, 0, 4.5))
max_width = Number(31)
center = Point(Point(15, 15, 0))
servers_text_component = Servers_Text_Component(face=face, bold=bold, italics=bool, size=size, content=content)  # -> out, A
# ---------- servers_text_component: VB ----------
    If(size = 0) Then
      size = 1
    End If


    Dim letters_plane As Rhino.Geometry.Plane
    letters_plane = Rhino.Geometry.Plane.WorldXY

    If(face <> Nothing And size > 0 And content <> Nothing) Then
      Dim te As System.Guid
      te = RhinoDoc.ActiveDoc.Objects.AddText(content, letters_plane, size, face, bold, italics)

      Dim txt As Rhino.DocObjects.TextObject
      txt = RhinoDoc.ActiveDoc.Objects.Find(te)

      Dim tt As Rhino.Geometry.TextEntity
      tt = txt.Geometry

      Dim curves() As Rhino.Geometry.Curve
      curves = tt.Explode()

      Dim curvesNum As Integer
      curvesNum = curves.GetUpperBound(0)


      Dim guids(curvesNum) As Guid
      For i As Integer = 0 To curvesNum
        Dim g As Guid
        g = RhinoDoc.ActiveDoc.Objects.AddCurve(curves(i))
        guids(i) = g
      Next
      A = guids
    End If
# ---------- end servers_text_component ----------
crv = Curve(servers_text_component.A)
Z = UnitZ(Factor=extrusion_vec)
planar = PlanarSrf(Edges=crv)
extr = Extrude(Base=planar, Direction=Z)
cap = CapHoles(Brep=extr)
bbox = BoundingBox(Content=cap, Plane=PlaneXY(0, 0, 0), UnionBox=True)  # -> Box, Box_2
explode = BrepComponents(Brep=bbox.Box)  # -> Faces, Edges, Vertices
pcen = PolygonCenter(Polyline=explode.Faces)  # -> CenterV, CenterE
item = ListItem(List=pcen.CenterV, Index=Slider(4, range=0..10), Wrap=False)
item_2 = ListItem(List=pcen.CenterV, Index=Slider(1, range=0..10), Wrap=False)
item_3 = ListItem(List=pcen.CenterV, Index=Slider(3, range=0..10), Wrap=False)
pcomp = Decompose(Point=item_2, System=PlaneXY(0, 0, 0))  # -> XComponent, YComponent, ZComponent
pcomp_2 = Decompose(Point=item_3, System=PlaneXY(0, 0, 0))  # -> XComponent, YComponent, ZComponent
subtraction = Subtraction(A=center, B=item)
move = Move(Geometry=planar, Motion=subtraction)  # -> Geometry, Transform
subtraction_2 = Subtraction(A=pcomp.XComponent, B=pcomp_2.XComponent)
eval = Evaluate(F="y/x", x=subtraction_2, y=max_width)
scale = Scale(Geometry=move.Geometry, Center=center, Factor=eval)  # -> Geometry, Transform
G = ClusterOutput(scale.Geometry)
