# Grasshopper definition voronoi_tiles_pendant_text.gh (Grasshopper 0.9.14)
# plug-ins: WeaverBird

textparam = String("naama")
center_x = Slider(15, range=0..20)
center_y = Slider(14.5, range=0..100)
a0 = Number(0.8)
a1 = Number(4)
a2 = Number(27)
a3 = Number(7)
max_height = Slider(13.6, range=4..30)
max_width = Slider(28, range=5..40)
toggle_bold = BooleanToggle(True)
join = StringJoin(Strings=textparam)
font = String("Arial")
cluster = Cluster(
    face=font,
    bold=toggle_bold,
    content=join,
    center_x=center_x,
    center_y=center_y,
    max_height=max_height,
    max_width=max_width)
custom_mesh_settings = SettingsCustom(
    StitchSeams=True,
    SimplePlanes=False,
    Refine=invert(True),
    MinCount=16,
    MaxCount=400,
    AspectRatio=10,
    MaxDistance=0,
    MaxAngle=20,
    MinEdge=0.2,
    MaxEdge=0.8)
extr = Extrude(Base=cluster, Direction=Vector(0, 0, 4))
jagged = SettingsSpeed()
mesh = MeshBrep(Brep=extr, Settings=custom_mesh_settings)
wbsplitquads = WeaverBirdsConstantQuadsSubdivision(MeshCurves=mesh, Level=1, SmoothNakedEdges=1)  # disabled
wbcatmullclark = WeaverBirdsCatmullClarkSubdivision(MeshCurves=mesh, Level=1, SmoothNakedEdges=1)
wblaplace = WeaverBirdsLaplacianSmoothing(MeshCurves=flatten(wbcatmullclark), Level=3, SmoothNakedEdges=1, Thin=1)  # -> flatten(OutputMeshCurves)
bbox = BoundingBox(Content=wblaplace, Plane=PlaneXY(0, 0, 0), UnionBox=True)  # -> Box, Box_2; disabled
smesh = SimpleMesh(Brep=bbox.Box)  # disabled
wbfacepolys = WeaverBirdsFacePolylines(Mesh=smesh)  # disabled
all = Geometry(wblaplace)
item = ListItem(List=wbfacepolys, Index=4, Wrap=False)  # disabled
offset = Offset(Curve=item, Distance=-1, Plane=PlaneXY(0, 0, 0), Corners=1)  # disabled
extr_2 = Extrude(Base=offset, Direction=Vector(0, 0, 2.6))  # disabled
cap = CapHoles(Brep=extr_2)  # disabled
bbox_2 = BoundingBox(Content=cap, Plane=PlaneXY(0, 0, 0), UnionBox=True)  # -> Box, Box_2; disabled
mbox = MeshBox(Base=bbox_2.Box, XCount=30, YCount=10, ZCount=20)  # disabled
wblaplace_2 = WeaverBirdsLaplacianSmoothing(MeshCurves=mbox, Level=2, SmoothNakedEdges=1, Thin=1)  # disabled

# ==== cluster Cluster
extrusion_vec = Vector(Vector(0, 0, 4.5))
max_height = ClusterInput()
content = ClusterInput()
center_x = ClusterInput()
face = ClusterInput()
bold = ClusterInput()
max_width = ClusterInput()
bool = Boolean(False)
center_y = ClusterInput()
servers_text_component = Servers_Text_Component(face=face, bold=bold, italics=bool, size=1, content=content)  # -> out, A
# ---------- servers_text_component: VB ----------
    If(size = 0) Then
      size = 1
    End If


    Dim letters_plane As Rhino.Geometry.Plane
    letters_plane = Rhino.Geometry.Plane.WorldXY

    If(face <> Nothing And size > 0 And content <> Nothing) Then
      Dim te As System.Guid
      te = RhinoDoc.ActiveDoc.Objects.AddText(content, letters_plane, size, face, bold, italics)

      Dim txt As Rhino.DocObjects.TextObject
      txt = RhinoDoc.ActiveDoc.Objects.Find(te)

      Dim tt As Rhino.Geometry.TextEntity
      tt = txt.Geometry

      Dim curves() As Rhino.Geometry.Curve
      curves = tt.Explode()

      Dim curvesNum As Integer
      curvesNum = curves.GetUpperBound(0)


      Dim guids(curvesNum) As Guid
      For i As Integer = 0 To curvesNum
        Dim g As Guid
        g = RhinoDoc.ActiveDoc.Objects.AddCurve(curves(i))
        guids(i) = g
      Next
      A = guids
      RhinoDoc.ActiveDoc.Objects.Delete(te, True)
    End If
# ---------- end servers_text_component ----------
Z = UnitZ(Factor=extrusion_vec)
pt = PointXYZ(XComponent=center_x, YComponent=center_y, ZComponent=0, System=PlaneXY(0, 0, 0))
planar = PlanarSrf(Edges=servers_text_component.A)
extr = Extrude(Base=planar, Direction=Vector(0, 0, 1))
cap = CapHoles(Brep=extr)
bbox_points = BboxPoints(C=cap)  # -> width, height, left, top, right, center, bottom
expression = Expression(x=max_width, y=max_height, z=bbox_points.width, u=bbox_points.height, Expression="min(x/z , y/u)")
pt_2 = Point()
subtraction = Subtraction(A=pt, B=bbox_points.center)
move = Move(Geometry=planar, Motion=subtraction)  # -> Geometry, Transform
scale = Scale(Geometry=move.Geometry, Center=pt, Factor=expression)  # -> Geometry, Transform
G = ClusterOutput(scale.Geometry)

# ==== cluster BboxPoints
C = ClusterInput()
bbox = BoundingBox(Content=C, Plane=PlaneXY(0, 0, 0), UnionBox=True)  # -> Box, Box_2
explode = BrepComponents(Brep=bbox.Box)  # -> Faces, Edges, Vertices
slider = Slider(5, range=0..12)
slider_2 = Slider(0, range=0..12)
pcen = PolygonCenter(Polyline=explode.Faces)  # -> CenterV, CenterE
pcomp = Decompose(Point=pcen.CenterV, System=PlaneXY(0, 0, 0))  # -> XComponent, YComponent, ZComponent
sort = SortList(Keys=pcomp.XComponent, ValuesA=pcen.CenterV)  # -> Keys, ValuesA
sort_2 = SortList(Keys=pcomp.YComponent, ValuesA=pcen.CenterV)  # -> Keys, ValuesA
item = ListItem(List=sort_2.ValuesA, Index=slider, Wrap=False)
item_2 = ListItem(List=sort_2.ValuesA, Index=slider_2, Wrap=False)
item_3 = ListItem(List=sort.ValuesA, Index=slider, Wrap=False)
item_4 = ListItem(List=sort.ValuesA, Index=slider_2, Wrap=False)
scale_nu = ScaleNU(Geometry=item, Plane=PlaneXY(0, 0, 0), ScaleX=1, ScaleY=1, ScaleZ=0)  # -> Geometry, Transform
scale_nu_2 = ScaleNU(Geometry=item_3, Plane=PlaneXY(0, 0, 0), ScaleX=1, ScaleY=1, ScaleZ=0)  # -> Geometry, Transform
scale_nu_3 = ScaleNU(Geometry=item_4, Plane=PlaneXY(0, 0, 0), ScaleX=1, ScaleY=1, ScaleZ=0)  # -> Geometry, Transform
ln = Line(StartPoint=scale_nu_3.Geometry, EndPoint=scale_nu_2.Geometry)
curvepoint = PointOnCurve(ln, parameter=0.5)
scale_nu_4 = ScaleNU(Geometry=item_3, Plane=PlaneXY(0, 0, 0), ScaleX=1, ScaleY=1, ScaleZ=0)  # -> Geometry, Transform
pcomp_2 = Decompose(Point=item_3, System=PlaneXY(0, 0, 0))  # -> XComponent, YComponent, ZComponent
pcomp_3 = Decompose(Point=item_4, System=PlaneXY(0, 0, 0))  # -> XComponent, YComponent, ZComponent
pcomp_4 = Decompose(Point=item, System=PlaneXY(0, 0, 0))  # -> XComponent, YComponent, ZComponent
pcomp_5 = Decompose(Point=item_2, System=PlaneXY(0, 0, 0))  # -> XComponent, YComponent, ZComponent
pt = Point(curvepoint)
subtraction = Subtraction(A=pcomp_2.XComponent, B=pcomp_3.XComponent)
subtraction_2 = Subtraction(A=pcomp_4.YComponent, B=pcomp_5.YComponent)
height = ClusterOutput(subtraction_2)
left = ClusterOutput(scale_nu_3.Geometry)
top = ClusterOutput(scale_nu.Geometry)
right = ClusterOutput(scale_nu_2.Geometry)
width = ClusterOutput(subtraction)
center = ClusterOutput(pt)
bottom = ClusterOutput(scale_nu_4.Geometry)
